# Grasshopper definition 2020.03.18_gh_runway_adaptive-style-transfer.ghx (Grasshopper 1.0.7)
# plug-ins: jSwan, Firefly.X, Data Tools

# ---- group: Decide which image is sent to Runway / Make sure your webcam is not busy with any other process
# #SCI-6365
# Enactive Design: Creative Applications through Concurrent Human-Machine Interaction
# Jose Luis García del Castillo y López
# Zach Seibold
# 
# Harvard University Graduate School of Design
# This file contains a definition that takes live feed from a webcam, and requests a style transfer from RunwayML running Adaptive-Style-Transfer model.
# 
# Instructions:
# - Download and install RunwayML: https://runwayml.com/ (tested with Beta v.0.10.32)
# - Open a new workspace, and add the Adaptive-Style-Transfer model to your workspace.
# - Run it (probably remotely, deploying it locally requires some additional setup).
# - Open this definition. Make sure your webcam is not busy with any other process.
# - Take a screenshot of the webcam using the camera icon on the FireFly screenshot component.
# - You should be ready to go! Now, simply "Choose what is sent to Runway" to request a prediction from the "Screenshot" (lightweight), or from the "Live Feed" (laggy).
# 
# Things should work as in the attached video files :)
# 
# The definition requires the FireFly plugin by Andy Payne, `jSwan` plug-in by Andrew Heumann and the `Data Tools` plug-in provided by the instructors.
# 
# This file is part of a course workshop for https://www.gsd.harvard.edu/course/enactive-design-creative-applications-through-concurrent-human-machine-interaction-spring-2020/
video_stream = WebCamVideoStream()

# ---- group: Choose what is sent to Runway
list = ValueList({"Nothing": 0, "Live Feed": 1, "Screenshot": 2}, selected="Nothing")

# ---- group: Decide which image is sent to Runway
here = CSharpScript()  # -> out, definitionFolder
# ---------- here: C# usings ----------
using System.IO;
# ---------- here: C# ----------
    string targetFolder = "";

    GH_Document gh_d = owner.OnPingDocument();
    if (gh_d.IsFilePathDefined)
    {
      string ghFilePath = gh_d.FilePath;
      targetFolder = Path.GetDirectoryName(ghFilePath);
    }
    else
    {
      Print("No local folder found, please save your definition locally.");
    }

    definitionFolder = targetFolder;
# ---------- end here ----------
panel = Panel("screenshot.png")

# ---- group: Decide which image is sent to Runway / Press the icon to take a screenshot
snapshot = Snapshot(FireflyBitmap=video_stream, FileDirectory=here.definitionFolder, FileName=panel)

# ---- group: Decide which image is sent to Runway (continued)
weave = Weave(Pattern=list, Stream0=" null", Stream1=video_stream, Stream2=snapshot, NullGaps=False)
painter = BitmapPainter(BitmapToPaint=weave)

# ---- group: Convert the image to base64 format
# The `Adaptive-Style-Transfer` model
# only takes jpeg-encoded images.
ff_bmptobmp = CSharpScript(ffbmp=painter, Reference="C:\Users\Jose Luis\AppData\Roaming\Grasshopper\Libraries\Firefly\Firefly.Bridge.dll")  # -> out, bmp
# ---------- ff_bmptobmp: C# usings ----------
using System.IO;
using System.Text;
using System.Drawing;
using System.Drawing.Imaging;

using Firefly_Bridge;
# ---------- ff_bmptobmp: C# ----------
    // This component converts a Firefly_Bitmap to a System.Bitmap

    if (ffbmp == null) return;

    // Clone the image to avoid references to ongoing streams and so
    Firefly_Bridge.Firefly_Bitmap fbmp = new Firefly_Bridge.Firefly_Bitmap();
    Firefly_Bridge.Firefly_Bitmap inbmp = ffbmp as Firefly_Bridge.Firefly_Bitmap;
    if(fbmp == null) fbmp = inbmp.Clone();
    else inbmp.CopyPixelsTo(ref fbmp);

    bmp = fbmp.Wbitmap;
# ---------- end ff_bmptobmp ----------
bmptobase64 = CSharpScript(bmp=ff_bmptobmp.bmp, format="jpeg")  # -> out, header, base64; inputs format: String
# ---------- bmptobase64: C# usings ----------
using System.IO;
using System.Text;
using System.Drawing;
using System.Drawing.Imaging;
# ---------- bmptobase64: C# ----------
    // This component takes a System.Bitmap and serializes it
    // to base64 for a specific encoding format.
    if (bmp == null) return;

    Bitmap bitmap = bmp as Bitmap;
    if (bitmap == null) {
      Component.AddRuntimeMessage(GH_RuntimeMessageLevel.Error, "Invalid bitmap.");
      return;
    }

    // Urgh, is there any way to do this more programmatically? Reflection?
    ImageFormat imgF;
    if (String.Equals(format, "jpeg", StringComparison.InvariantCultureIgnoreCase) ||
      String.Equals(format, "jpg", StringComparison.InvariantCultureIgnoreCase))
    {
      imgF = ImageFormat.Jpeg;
    }
    else if (String.Equals(format, "png", StringComparison.InvariantCultureIgnoreCase))
    {
      imgF = ImageFormat.Png;
    }
    else if (String.Equals(format, "bmp", StringComparison.InvariantCultureIgnoreCase))
    {
      imgF = ImageFormat.Bmp;
    }
    else if (String.Equals(format, "gif", StringComparison.InvariantCultureIgnoreCase))
    {
      imgF = ImageFormat.Gif;
    }
      // and the rest of the formats...
    else
    {
      Component.AddRuntimeMessage(GH_RuntimeMessageLevel.Error, "Unrecognized image format");
      return;
    }

    string base64Header = ToBase64ImageTag(imgF);
    string base64ImageString = ToBase64String(bitmap, imgF);

    header = base64Header;
    base64 = base64ImageString;
# ---------- bmptobase64: C# additional code ----------
  // From https://softwarebydefault.com/2013/02/23/bitmap-base64-strings/
  public string ToBase64String(Bitmap bmp, ImageFormat imageFormat)
  {
    string base64String = string.Empty;

    MemoryStream memoryStream = new MemoryStream();
    bmp.Save(memoryStream, imageFormat);

    memoryStream.Position = 0;
    byte[] byteBuffer = memoryStream.ToArray();

    memoryStream.Close();

    base64String = Convert.ToBase64String(byteBuffer);
    byteBuffer = null;

    return base64String;
  }

  // From https://softwarebydefault.com/2013/02/23/bitmap-base64-strings/
  public string ToBase64ImageTag(ImageFormat imageFormat)
  {
    return "data:image/" + imageFormat.ToString() + ";base64,";
  }
# ---------- end bmptobase64 ----------
panel_2 = Panel("jpeg")
join = TextJoin(Text=[bmptobase64.header, bmptobase64.base64])
panel_3 = Panel(bmptobase64.header)
text_gate = TextGate(Text=join)
txt = Text(text_gate)

# ---- group: Send the request to Runway, running a PoseNet model.
null = NullItem(Item=bmptobase64.base64)  # -> NullFlags, InvalidFlags, Description
send = BooleanToggle(True)
not = GateNot(A=null.NullFlags)
and = GateAnd(A=send, B=not)
dispatch = Dispatch(List=txt, DispatchPattern=and)  # -> ListA, ListB
rejson = SerializeJson(ContentImage=dispatch.ListA, IncludeNullAndEmptyProperties=False)
text_gate_2 = TextGate(Text=rejson)
http_post = CSharpScript(url="http://localhost:8000/query", JSONcontent=text_gate_2, timeout="5000")  # -> out, response; inputs url: String, JSONcontent: String, timeout: Int32
# ---------- http_post: C# usings ----------
using System.Linq;
using System.Data;
using System.Drawing;
using System.Reflection;
using System.Windows.Forms;
using System.Xml;
using System.Xml.Linq;
using System.Runtime.InteropServices;

using System.Net;
using System.Text;  // for class Encoding
using System.IO;    // for StreamReader

using Rhino.DocObjects;
using Rhino.Collections;
using GH_IO;
using GH_IO.Serialization;
# ---------- http_post: C# ----------
    if (url == null) return;

    // From https://stackoverflow.com/a/4015346/1934487

    var request = (HttpWebRequest) WebRequest.Create(url);

    request.Timeout = timeout;

    // Parameters can be added to the query URL
    //var postData = "thing1=" + Uri.EscapeDataString("hello");
    //postData += "&thing2=" + Uri.EscapeDataString("world");

    var data = Encoding.ASCII.GetBytes(JSONcontent);

    request.Method = "POST";
    request.ContentType = "application/json";
    request.ContentLength = data.Length;

    using (var stream = request.GetRequestStream())
    {
      stream.Write(data, 0, data.Length);
    }

    var res = (HttpWebResponse) request.GetResponse();

    var responseString = new StreamReader(res.GetResponseStream()).ReadToEnd();

    response = responseString;
# ---------- end http_post ----------
panel_4 = Panel(http_post.out)

# ---- group: Get model info from Runway
request_timeout_ms = Slider(500, range=0..5000)
null_2 = NullItem(Item=http_post.response)  # -> NullFlags, InvalidFlags, Description
force_request = BooleanToggle(False)
not_2 = GateNot(A=null_2.NullFlags)
or = GateOr(A=not_2, B=force_request)
bool = Boolean(or)
http_get = CSharpScript(url="http://localhost:8000/data", timeout=request_timeout_ms, send=bool)  # -> out, response; inputs url: String, timeout: Int32, send: Boolean
# ---------- http_get: C# usings ----------
using System.IO;
using System.Linq;
using System.Data;
using System.Drawing;
using System.Reflection;
using System.Windows.Forms;
using System.Xml;
using System.Xml.Linq;
using System.Runtime.InteropServices;

using Rhino.DocObjects;
using Rhino.Collections;
using GH_IO;
using GH_IO.Serialization;
# ---------- http_get: C# ----------
    if (url == null || !send) return;
    
    if (timeout == 0) timeout = 5000;

    System.Net.ServicePointManager.Expect100Continue = true;
    System.Net.ServicePointManager.SecurityProtocol = System.Net.SecurityProtocolType.Tls12; //the auth type

    var request = System.Net.WebRequest.Create(url);
    request.Timeout = timeout;

    // If required by the server, set the credentials.
    request.Credentials = System.Net.CredentialCache.DefaultCredentials;

    // Get the response.
    var res = (System.Net.HttpWebResponse) request.GetResponse();

    // Display the status.
    Console.WriteLine(res.StatusDescription);

    // Get the stream containing content returned by the server.
    Stream dataStream = res.GetResponseStream();

    // Open the stream using a StreamReader for easy access.
    StreamReader reader = new StreamReader (dataStream);

    // Read the content.
    response = reader.ReadToEnd();

    reader.Close();
    dataStream.Close();
    res.Close();
# ---------- end http_get ----------
http_get_2 = CSharpScript(url="http://localhost:8000/error", timeout=request_timeout_ms, send=bool)  # -> out, response; inputs url: String, timeout: Int32, send: Boolean; same code as http_get
http_get_3 = CSharpScript(url="http://localhost:8000/info", timeout=request_timeout_ms, send=bool)  # -> out, response; inputs url: String, timeout: Int32, send: Boolean; same code as http_get
model_info_response_schema = Panel(http_get_3.response)
error_messages = Panel(http_get_2.response)

# ---- group: Deserialize the response into an image
dejsonkv = DeserializeKeysAndValues(JSON=http_post.response, Keys="stylizedImage")  # -> Key, Value
base64tobmp = CSharpScript(base64=dejsonkv.Value)  # -> out, bmp; inputs base64: String
# ---------- base64tobmp: C# usings ----------
using System.IO;
using System.Text;
using System.Drawing;
using System.Drawing.Imaging;
using System.Runtime.InteropServices;
# ---------- base64tobmp: C# ----------
    // This component takes a base64 string and deserializes it
    // into a System.Bitmap.
    if (base64 == null) return;

    Bitmap bitmap = Base64StringToBitmap(base64);

    bmp = bitmap;
# ---------- base64tobmp: C# additional code ----------
  // From https://softwarebydefault.com/2013/03/01/base64-strings-bitmap/
  public Bitmap Base64StringToBitmap(string base64String)
  {
    string base64Body = RemoveBase64Header(base64String);

    Bitmap bmpReturn = null;

    byte[] byteBuffer = Convert.FromBase64String(base64Body);
    MemoryStream memoryStream = new MemoryStream(byteBuffer);

    memoryStream.Position = 0;

    bmpReturn = (Bitmap) Bitmap.FromStream(memoryStream);

    // Don't dispose the streams.
    // Since the bitmap was created from a stream, it will give GDI+
    // errors if it gets disposed on saving or similar.
    // https://stackoverflow.com/a/336396/1934487
    //memoryStream.Close();
    //memoryStream = null;
    byteBuffer = null;

    return bmpReturn;
  }

  // From https://stackoverflow.com/a/30525829/1934487
  public string RemoveBase64Header(string base64String)
  {
    if (base64String.Contains(","))
    {
      return base64String.Substring(base64String.IndexOf(",") + 1,
        base64String.Length - (base64String.IndexOf(",") + 1));
    }
    return base64String;
  }
# ---------- end base64tobmp ----------
bmptoff_bmp = CSharpScript(bmp=base64tobmp.bmp, Reference="C:\USERS\JOSE LUIS\APPDATA\ROAMING\GRASSHOPPER\LIBRARIES\FIREFLY\Firefly.Bridge.dll")  # -> out, ffbmp
# ---------- bmptoff_bmp: C# usings ----------
using System.IO;
using System.Text;
using System.Drawing;
using System.Drawing.Imaging;
using System.Runtime.InteropServices;

using Firefly_Bridge;
# ---------- bmptoff_bmp: C# ----------
    // This component takes a System.Bitmap and converts it
    // into a Firefly_Bitmap.
    if (bmp == null) return;

    Bitmap bitmap = bmp as Bitmap;
    if (bitmap == null) {
      Component.AddRuntimeMessage(GH_RuntimeMessageLevel.Error, "Invalid bitmap.");
      return;
    }

    Firefly_Bitmap fbmp = BitmapToFFBitmap(bitmap);

    bmp = bitmap;
    ffbmp = fbmp;
# ---------- bmptoff_bmp: C# additional code ----------
  // Create a FFBitmap from a System.Bitmap
  public Firefly_Bitmap BitmapToFFBitmap(Bitmap bmp)
  {
    // Figure out RGB or RGBA format (quick and dirty!)
    int colorDepth = Image.GetPixelFormatSize(bmp.PixelFormat);
    int channels = colorDepth / 8;
    if (channels != 3 && channels != 4) {
      Component.AddRuntimeMessage(GH_RuntimeMessageLevel.Error, "Wrong bitmap format");
      return null;
    }

    Firefly_Bitmap theBitmap = new Firefly_Bitmap();
    theBitmap.SetSize(bmp.Width, bmp.Height);

    System.Drawing.Imaging.BitmapData bd = bmp.LockBits(new Rectangle(0, 0, bmp.Width, bmp.Height), System.Drawing.Imaging.ImageLockMode.ReadOnly, bmp.PixelFormat);

    // Get the address of the first line.
    IntPtr ptr = bd.Scan0;

    // Declare an array to hold the bytes of the bitmap.
    int bytes = bd.Stride * bmp.Height;
    byte[] rgbValues = new byte[bytes];

    // Copy the RGB values into the array.
    System.Runtime.InteropServices.Marshal.Copy(ptr, rgbValues, 0, bytes);

    if (channels == 4)
    {
      int i, j, k = 0;
      double ra, ga, ba, aa;
      for (j = bmp.Height - 1; j >= 0; --j)
      {
        for (i = 0; i < bmp.Width; ++i)
        {
          ra = rgbValues[k];
          ga = rgbValues[k + 1];
          ba = rgbValues[k + 2];
          aa = rgbValues[k + 3];

          theBitmap.pixels[i, j].B = (byte) ra;
          theBitmap.pixels[i, j].G = (byte) ga;
          theBitmap.pixels[i, j].R = (byte) ba;
          theBitmap.pixels[i, j].A = (byte) aa;

          theBitmap.pixels[i, j].V = (byte) ( (theBitmap.pixels[i, j].R + theBitmap.pixels[i, j].G + theBitmap.pixels[i, j].B) / 3);
          k += channels;
        }
      }
    }
    else
    {
      int i, j, k = 0;
      double ra, ga, ba, aa;
      for (j = bmp.Height - 1; j >= 0; --j)
      {
        for (i = 0; i < bmp.Width; ++i)
        {
          ra = rgbValues[k];
          ga = rgbValues[k + 1];
          ba = rgbValues[k + 2];
          aa = 255;

          theBitmap.pixels[i, j].B = (byte) ra;
          theBitmap.pixels[i, j].G = (byte) ga;
          theBitmap.pixels[i, j].R = (byte) ba;
          theBitmap.pixels[i, j].A = (byte) aa;

          theBitmap.pixels[i, j].V = (byte) ( (theBitmap.pixels[i, j].R + theBitmap.pixels[i, j].G + theBitmap.pixels[i, j].B) / 3);
          k += channels;
        }
      }
    }


    theBitmap.ComputeGradient();

    bmp.UnlockBits(bd);

    return theBitmap;
  }
# ---------- end bmptoff_bmp ----------
painter_2 = BitmapPainter(BitmapToPaint=bmptoff_bmp.ffbmp)

# ---- group: RunwayML response!
data = Data(bmptoff_bmp.ffbmp)
painter_3 = BitmapPainter(BitmapToPaint=data)

# ---- group: Save the image to this definition's folder
here_2 = CSharpScript()  # -> out, definitionFolder; same code as here
savebitmap = CSharpScript(bmp=base64tobmp.bmp, folder=here_2.definitionFolder, filename="prediction.png")  # -> out, msg; inputs folder: String, filename: String
# ---------- savebitmap: C# ----------
    // This component saves a System.Bitmap to a location on the system.
    if (bmp == null || folder == null || filename == null) return;

    Bitmap bitmap = bmp as Bitmap;
    if (bitmap == null) {
      Component.AddRuntimeMessage(GH_RuntimeMessageLevel.Error, "Invalid bitmap.");
      return;
    }

    string fullPath = Path.Combine(folder, filename);

    // Bitmap.Save() will use the bitmap's encoding, no matter the filename.
    // Use the extension in the filename to figure out the best file format.
    string format = Path.GetExtension(fullPath);
    format = format.Substring(1, format.Length - 1);  // remove initial dot
    Print(format);

    // Urgh, is there any way to do this more programmatically? Reflection?
    ImageFormat imgF;
    if (String.Equals(format, "jpeg", StringComparison.InvariantCultureIgnoreCase) ||
      String.Equals(format, "jpg", StringComparison.InvariantCultureIgnoreCase))
    {
      imgF = ImageFormat.Jpeg;
    }
    else if (String.Equals(format, "png", StringComparison.InvariantCultureIgnoreCase))
    {
      imgF = ImageFormat.Png;
    }
    else if (String.Equals(format, "bmp", StringComparison.InvariantCultureIgnoreCase))
    {
      imgF = ImageFormat.Bmp;
    }
    else if (String.Equals(format, "gif", StringComparison.InvariantCultureIgnoreCase))
    {
      imgF = ImageFormat.Gif;
    }
    else if (String.Equals(format, "tiff", StringComparison.InvariantCultureIgnoreCase))
    {
      imgF = ImageFormat.Tiff;
    }
      // and the rest of the formats...
    else
    {
      Component.AddRuntimeMessage(GH_RuntimeMessageLevel.Error, "Unrecognized image format");
      return;
    }

    bitmap.Save(fullPath, imgF);

    msg = "Successfully saved bitmap to " + fullPath;
# ---------- end savebitmap ----------
