# Grasshopper definition gh_runway_adaptive-style-transfer.ghx (Grasshopper 1.0.7)
# plug-ins: Firefly.X, Data Tools, jSwan

# ---- group: Decide which image is sent to Runway / Make sure your webcam is not busy with any other process
# #SCI-6365
# Enactive Design: Creative Applications through Concurrent Human-Machine Interaction
# Jose Luis García del Castillo y López
# 
# Harvard University Graduate School of Design
# See README file for instructions.
video_stream = WebCamVideoStream()

# ---- group: Choose what is sent to Runway
list = ValueList({"Nothing": 0, "Live Feed": 1, "Screenshot": 2}, selected="Nothing")

# ----
text_gate = TextGate(Text=<missing>)

# ---- group: Decide which image is sent to Runway
here = CSharpScript()  # -> out, definitionFolder
# ---------- here: C# usings ----------
using System.IO;
# ---------- here: C# ----------
    string targetFolder = "";

    GH_Document gh_d = owner.OnPingDocument();
    if (gh_d.IsFilePathDefined)
    {
      string ghFilePath = gh_d.FilePath;
      targetFolder = Path.GetDirectoryName(ghFilePath);
    }
    else
    {
      Print("No local folder found, please save your definition locally.");
    }

    definitionFolder = targetFolder;
# ---------- end here ----------
panel = Panel("screenshot.png")

# ---- group: Decide which image is sent to Runway / Press the icon to take a screenshot
snapshot = Snapshot(FireflyBitmap=video_stream, FileDirectory=here.definitionFolder, FileName=panel)

# ---- group: Decide which image is sent to Runway (continued)
weave = Weave(Pattern=list, Stream0=" null", Stream1=video_stream, Stream2=snapshot, NullGaps=False)
painter = BitmapPainter(BitmapToPaint=weave)

# ---- group: Convert the image to base64 format
# The `Adaptive-Style-Transfer` model
# only takes jpeg-encoded images.
panel_2 = Panel("0")
encode = EncodeFireflyBitmapToBase64(FireflyBitmap=painter, ImageFormat=panel_2)  # -> ImageHeader, Base64
panel_3 = Panel(encode.ImageHeader)
join = TextJoin(Text=[encode.ImageHeader, encode.Base64])

# ---- group: Gate the input stream to avoid sending one request per webcam trigger
text_gate_2 = TextGate(Txt=join)
txt = Text(text_gate_2)

# ---- group: Send the request to Runway, running a PoseNet model.
null = NullItem(Item=encode.Base64)  # -> NullFlags, InvalidFlags, Description
send = BooleanToggle(True)
not = GateNot(A=null.NullFlags)
and = GateAnd(A=send, B=not)
dispatch = Dispatch(List=txt, DispatchPattern=and)  # -> ListA, ListB
rejson = SerializeJson(ContentImage=dispatch.ListA, IncludeNullAndEmptyProperties=False)
text_gate_3 = TextGate(Text=rejson)

# ----
text_gate_4 = TextGate(Txt=rejson)

# ---- group: Send the request to Runway, running a PoseNet model. (continued)
http_post = CSharpScript(url="http://localhost:8000/query", JSONcontent=text_gate_4, timeout="5000")  # -> out, response; inputs url: String, JSONcontent: String, timeout: Int32
# ---------- http_post: C# usings ----------
using System.Linq;
using System.Data;
using System.Drawing;
using System.Reflection;
using System.Windows.Forms;
using System.Xml;
using System.Xml.Linq;
using System.Runtime.InteropServices;

using System.Net;
using System.Text;  // for class Encoding
using System.IO;    // for StreamReader

using Rhino.DocObjects;
using Rhino.Collections;
using GH_IO;
using GH_IO.Serialization;
# ---------- http_post: C# ----------
    if (url == null) return;

    // From https://stackoverflow.com/a/4015346/1934487

    var request = (HttpWebRequest) WebRequest.Create(url);

    request.Timeout = timeout;

    // Parameters can be added to the query URL
    //var postData = "thing1=" + Uri.EscapeDataString("hello");
    //postData += "&thing2=" + Uri.EscapeDataString("world");

    var data = Encoding.ASCII.GetBytes(JSONcontent);

    request.Method = "POST";
    request.ContentType = "application/json";
    request.ContentLength = data.Length;

    using (var stream = request.GetRequestStream())
    {
      stream.Write(data, 0, data.Length);
    }

    var res = (HttpWebResponse) request.GetResponse();

    var responseString = new StreamReader(res.GetResponseStream()).ReadToEnd();

    response = responseString;
# ---------- end http_post ----------
panel_4 = Panel(http_post.out)

# ---- group: Get model info from Runway
request_timeout_ms = Slider(500, range=0..5000)
null_2 = NullItem(Item=http_post.response)  # -> NullFlags, InvalidFlags, Description
force_request = BooleanToggle(False)
not_2 = GateNot(A=null_2.NullFlags)
or = GateOr(A=not_2, B=force_request)
bool = Boolean(or)
http_get = CSharpScript(url="http://localhost:8000/data", timeout=request_timeout_ms, send=bool)  # -> out, response; inputs url: String, timeout: Int32, send: Boolean
# ---------- http_get: C# usings ----------
using System.IO;
using System.Linq;
using System.Data;
using System.Drawing;
using System.Reflection;
using System.Windows.Forms;
using System.Xml;
using System.Xml.Linq;
using System.Runtime.InteropServices;

using Rhino.DocObjects;
using Rhino.Collections;
using GH_IO;
using GH_IO.Serialization;
# ---------- http_get: C# ----------
    if (url == null || !send) return;
    
    if (timeout == 0) timeout = 5000;

    System.Net.ServicePointManager.Expect100Continue = true;
    System.Net.ServicePointManager.SecurityProtocol = System.Net.SecurityProtocolType.Tls12; //the auth type

    var request = System.Net.WebRequest.Create(url);
    request.Timeout = timeout;

    // If required by the server, set the credentials.
    request.Credentials = System.Net.CredentialCache.DefaultCredentials;

    // Get the response.
    var res = (System.Net.HttpWebResponse) request.GetResponse();

    // Display the status.
    Console.WriteLine(res.StatusDescription);

    // Get the stream containing content returned by the server.
    Stream dataStream = res.GetResponseStream();

    // Open the stream using a StreamReader for easy access.
    StreamReader reader = new StreamReader (dataStream);

    // Read the content.
    response = reader.ReadToEnd();

    reader.Close();
    dataStream.Close();
    res.Close();
# ---------- end http_get ----------
http_get_2 = CSharpScript(url="http://localhost:8000/error", timeout=request_timeout_ms, send=bool)  # -> out, response; inputs url: String, timeout: Int32, send: Boolean; same code as http_get
http_get_3 = CSharpScript(url="http://localhost:8000/info", timeout=request_timeout_ms, send=bool)  # -> out, response; inputs url: String, timeout: Int32, send: Boolean; same code as http_get
model_info_response_schema = Panel(http_get_3.response)
error_messages = Panel(http_get_2.response)

# ---- group: Deserialize the response into an image
dejsonkv = DeserializeKeysAndValues(JSON=http_post.response, Keys="stylizedImage")  # -> Key, Value

# ----
decode = DecodeBase64ToFireflyBitmap(Base64=dejsonkv.Value)

# ---- group: RunwayML response!
data = Data(decode)
painter_2 = BitmapPainter(BitmapToPaint=data)

# ---- group: Save the image to this definition's folder
here_2 = CSharpScript()  # -> out, definitionFolder; same code as here
save_bitmap = SaveBitmap(FireflyBitmap=decode, FileDirectory=here_2.definitionFolder, FileName="prediction.png")

# ---- group: Deserialize the response into an image (continued)
painter_3 = BitmapPainter(BitmapToPaint=decode)
