# Grasshopper definition gh_runway_posenet.ghx (Grasshopper 1.0.7)
# plug-ins: Firefly.X, jSwan, Dynamic Data Tools

# ---- group: Decide which image is sent to Runway / Make sure your webcam is not busy with any other process
# #SCI-6365
# Enactive Design: Creative Applications through Concurrent Human-Machine Interaction
# Jose Luis García del Castillo y López
# 
# Harvard University Graduate School of Design
# See README file for instructions.
video_stream = WebCamVideoStream()

# ---- group: Choose what is sent to Runway
list = ValueList({"Nothing": 0, "Live Feed": 1, "Screenshot": 2}, selected="Screenshot")

# ---- group: Decide which image is sent to Runway
c_script = CSharpScript()  # -> out, definitionFolder
# ---------- c_script: C# usings ----------
using System.IO;
# ---------- c_script: C# ----------
    string targetFolder = "";

    GH_Document gh_d = owner.OnPingDocument();
    if (gh_d.IsFilePathDefined)
    {
      string ghFilePath = gh_d.FilePath;
      targetFolder = Path.GetDirectoryName(ghFilePath);
    }
    else
    {
      Print("No local folder found, please save your definition locally.");
    }

    definitionFolder = targetFolder;
# ---------- end c_script ----------
panel = Panel("screenshot.png")

# ---- group: Decide which image is sent to Runway / Press the icon to take a screenshot
snapshot = Snapshot(FireflyBitmap=video_stream, FileDirectory=c_script.definitionFolder, FileName=panel)

# ---- group: Decide which image is sent to Runway (continued)
weave = Weave(Pattern=list, Stream0=" null", Stream1=video_stream, Stream2=snapshot, NullGaps=False)
painter = BitmapPainter(BitmapToPaint=weave)

# ---- group: Convert the image to base64 format
encode = EncodeFireflyBitmapToBase64(FireflyBitmap=painter, ImageFormat="1")  # -> ImageHeader, Base64
panel_2 = Panel(encode.ImageHeader)
join = TextJoin(Text=[encode.ImageHeader, encode.Base64])

# ---- group: Gate the input stream to avoid sending one request per webcam trigger
text_gate = TextGate(Txt=join)
txt = Text(text_gate)

# ---- group: Send the request to Runway, running a PoseNet model.
send = BooleanToggle(True)
maxposedetection = Slider(5, range=1..20)
scorethreshold = Slider(0.25, range=0..1)
list_2 = ValueList({"Multi Pose": "multi pose", "Single Pose": "single pose"}, selected="Multi Pose")
dispatch = Dispatch(List=txt, DispatchPattern=send)  # -> ListA, ListB
rejson = SerializeJson(
    Image=dispatch.ListA,
    EstimationType=list_2,
    MaxPoseDetections=maxposedetection,
    ScoreThreshold=scorethreshold,
    IncludeNullAndEmptyProperties=False)
text_gate_2 = TextGate(Txt=rejson)
http_post = CSharpScript(url="http://localhost:8000/query", JSONcontent=text_gate_2, timeout="5000")  # -> out, response; inputs url: String, JSONcontent: String, timeout: Int32
# ---------- http_post: C# usings ----------
using System.Linq;
using System.Data;
using System.Drawing;
using System.Reflection;
using System.Windows.Forms;
using System.Xml;
using System.Xml.Linq;
using System.Runtime.InteropServices;

using System.Net;
using System.Text;  // for class Encoding
using System.IO;    // for StreamReader

using Rhino.DocObjects;
using Rhino.Collections;
using GH_IO;
using GH_IO.Serialization;
# ---------- http_post: C# ----------
    if (url == null) return;

    // From https://stackoverflow.com/a/4015346/1934487

    var request = (HttpWebRequest) WebRequest.Create(url);

    request.Timeout = timeout;

    // Parameters can be added to the query URL
    //var postData = "thing1=" + Uri.EscapeDataString("hello");
    //postData += "&thing2=" + Uri.EscapeDataString("world");

    var data = Encoding.ASCII.GetBytes(JSONcontent);

    request.Method = "POST";
    request.ContentType = "application/json";
    request.ContentLength = data.Length;

    using (var stream = request.GetRequestStream())
    {
      stream.Write(data, 0, data.Length);
    }

    var res = (HttpWebResponse) request.GetResponse();

    var responseString = new StreamReader(res.GetResponseStream()).ReadToEnd();

    response = responseString;
# ---------- end http_post ----------
panel_3 = Panel(http_post.out)
panel_4 = Panel(http_post.response)

# ----
null = NullItem(Item=http_post.response)  # -> NullFlags, InvalidFlags, Description
request_timeout_ms = Slider(500, range=0..5000)
force_request = BooleanToggle(False)
not = GateNot(A=null.NullFlags)
or = GateOr(A=not, B=force_request)
bool = Boolean(or)
http_get = CSharpScript(url="http://localhost:8000/data", timeout=request_timeout_ms, send=bool)  # -> out, response; inputs url: String, timeout: Int32, send: Boolean
# ---------- http_get: C# usings ----------
using System.IO;
using System.Linq;
using System.Data;
using System.Drawing;
using System.Reflection;
using System.Windows.Forms;
using System.Xml;
using System.Xml.Linq;
using System.Runtime.InteropServices;

using Rhino.DocObjects;
using Rhino.Collections;
using GH_IO;
using GH_IO.Serialization;
# ---------- http_get: C# ----------
    if (url == null || !send) return;
    
    if (timeout == 0) timeout = 5000;

    System.Net.ServicePointManager.Expect100Continue = true;
    System.Net.ServicePointManager.SecurityProtocol = System.Net.SecurityProtocolType.Tls12; //the auth type

    var request = System.Net.WebRequest.Create(url);
    request.Timeout = timeout;

    // If required by the server, set the credentials.
    request.Credentials = System.Net.CredentialCache.DefaultCredentials;

    // Get the response.
    var res = (System.Net.HttpWebResponse) request.GetResponse();

    // Display the status.
    Console.WriteLine(res.StatusDescription);

    // Get the stream containing content returned by the server.
    Stream dataStream = res.GetResponseStream();

    // Open the stream using a StreamReader for easy access.
    StreamReader reader = new StreamReader (dataStream);

    // Read the content.
    response = reader.ReadToEnd();

    reader.Close();
    dataStream.Close();
    res.Close();
# ---------- end http_get ----------
http_get_2 = CSharpScript(url="http://localhost:8000/error", timeout=request_timeout_ms, send=bool)  # -> out, response; inputs url: String, timeout: Int32, send: Boolean; same code as http_get
http_get_3 = CSharpScript(url="http://localhost:8000/info", timeout=request_timeout_ms, send=bool)  # -> out, response; inputs url: String, timeout: Int32, send: Boolean; same code as http_get
last_response = Panel(http_get.response)
error_messages = Panel(http_get_2.response)
dejson = DeserializeJson(JSON=http_get_3.response, OutputsLocked=False)  # -> Inputs, Outputs
model_info_response_schema = Panel(dejson.Outputs)

# ---- group: Deserialize the response into points
dejsonkv = DeserializeKeysAndValues(JSON=http_post.response, Keys="poses")  # -> Key, Value
dejson_2 = DeserializeJson(JSON=dejsonkv.Value, OutputsLocked=False)
dejson_3 = DeserializeJson(JSON=dejson_2, OutputsLocked=False)
dejson_4 = DeserializeJson(JSON=dejson_3, OutputsLocked=False)
panel_5 = Panel(dejson_4)
item = ListItem(List=dejson_4, Index="1", Wrap=False)  # -> flatten(Item)
item_2 = ListItem(List=dejson_4, Index="0", Wrap=False)  # -> flatten(Item)
neg = Negative(Value=item)
pt = ConstructPoint(XCoordinate=item_2, YCoordinate=neg, ZCoordinate=0)
panel_6 = Panel(pt)

# ---- group: Use the schema from Runway to join the nodes with lines
dejson_5 = DeserializeJson(JSON=dejson.Outputs, OutputsLocked=False)  # -> Description, ItemType, Name, Type
dejson_6 = DeserializeJson(JSON=dejson_5.ItemType, OutputsLocked=False)  # -> Connections, Labels, Length, Name, Type, Max, Min
clean = CleanTree(RemoveNulls=True, RemoveInvalid=True, RemoveEmpty=True, Tree=dejson_6.Labels)
panel_7 = Panel(clean)
dejson_7 = DeserializeJson(JSON=dejson_6.Connections, OutputsLocked=False)
item_3 = ListItem(List=dejson_7, Index="1", Wrap=False)
item_4 = ListItem(List=dejson_7, Index="0", Wrap=False)
panel_8 = Panel(dejson_7)
fsim = FindSimilarMember(Data=item_4, Set=panel_7)  # -> Hit, Index
panel_9 = Panel(fsim.Index)
fsim_2 = FindSimilarMember(Data=item_3, Set=panel_7)  # -> Hit, Index
panel_10 = Panel(fsim_2.Index)
item_5 = ListItem(List=pt, Index=fsim_2.Index, Wrap=True)
item_6 = ListItem(List=pt, Index=fsim.Index, Wrap=True)
ln = Line(StartPoint=item_6, EndPoint=item_5)
