# Grasshopper definition gh_runway_gpt2.ghx (Grasshopper 1.0.7)
# plug-ins: jSwan

# ---- group: Type the input text for RunwayML and the model parameters
# #SCI-6365
# Enactive Design: Creative Applications through Concurrent Human-Machine Interaction
# Jose Luis García del Castillo y López
# 
# Harvard University Graduate School of Design
# See README file for instructions.
panel = Panel("The morning came, and no one had yet")
maximum_characters = Slider(512, range=8..1024)
top_p = Slider(0.9, range=0.1..1)
seed = Slider(1000, range=0..1000)

# ---- group: Send the request to Runway, running a "Cannes-Case-Generator model.
rejson = SerializeJson(Prompt=panel, Max_characters=maximum_characters, Top_p=top_p, Seed=seed, IncludeNullAndEmptyProperties=False)
dam = DataDam(DataA=rejson, BufferDelay=10000000, BufferMode=2)
http_post = CSharpScript(url="http://localhost:8000/query", JSONcontent=dam, timeout="5000")  # -> out, response; inputs url: String, JSONcontent: String, timeout: Int32
# ---------- http_post: C# usings ----------
using System.Linq;
using System.Data;
using System.Drawing;
using System.Reflection;
using System.Windows.Forms;
using System.Xml;
using System.Xml.Linq;
using System.Runtime.InteropServices;

using System.Net;
using System.Text;  // for class Encoding
using System.IO;    // for StreamReader

using Rhino.DocObjects;
using Rhino.Collections;
using GH_IO;
using GH_IO.Serialization;
# ---------- http_post: C# ----------
    if (url == null) return;

    // From https://stackoverflow.com/a/4015346/1934487

    var request = (HttpWebRequest) WebRequest.Create(url);

    request.Timeout = timeout;

    // Parameters can be added to the query URL
    //var postData = "thing1=" + Uri.EscapeDataString("hello");
    //postData += "&thing2=" + Uri.EscapeDataString("world");

    var data = Encoding.ASCII.GetBytes(JSONcontent);

    request.Method = "POST";
    request.ContentType = "application/json";
    request.ContentLength = data.Length;

    using (var stream = request.GetRequestStream())
    {
      stream.Write(data, 0, data.Length);
    }

    var res = (HttpWebResponse) request.GetResponse();

    var responseString = new StreamReader(res.GetResponseStream()).ReadToEnd();

    response = responseString;
# ---------- end http_post ----------
panel_2 = Panel(http_post.out)
panel_3 = Panel(http_post.response)

# ----
null = NullItem(Item=http_post.response)  # -> NullFlags, InvalidFlags, Description
request_timeout_ms = Slider(500, range=0..5000)
force_request = BooleanToggle(False)
not = GateNot(A=null.NullFlags)
or = GateOr(A=not, B=force_request)
bool = Boolean(or)
http_get = CSharpScript(url="http://localhost:8000/data", timeout=request_timeout_ms, send=bool)  # -> out, response; inputs url: String, timeout: Int32, send: Boolean
# ---------- http_get: C# usings ----------
using System.IO;
using System.Linq;
using System.Data;
using System.Drawing;
using System.Reflection;
using System.Windows.Forms;
using System.Xml;
using System.Xml.Linq;
using System.Runtime.InteropServices;

using Rhino.DocObjects;
using Rhino.Collections;
using GH_IO;
using GH_IO.Serialization;
# ---------- http_get: C# ----------
    if (url == null || !send) return;
    
    if (timeout == 0) timeout = 5000;

    System.Net.ServicePointManager.Expect100Continue = true;
    System.Net.ServicePointManager.SecurityProtocol = System.Net.SecurityProtocolType.Tls12; //the auth type

    var request = System.Net.WebRequest.Create(url);
    request.Timeout = timeout;

    // If required by the server, set the credentials.
    request.Credentials = System.Net.CredentialCache.DefaultCredentials;

    // Get the response.
    var res = (System.Net.HttpWebResponse) request.GetResponse();

    // Display the status.
    Console.WriteLine(res.StatusDescription);

    // Get the stream containing content returned by the server.
    Stream dataStream = res.GetResponseStream();

    // Open the stream using a StreamReader for easy access.
    StreamReader reader = new StreamReader (dataStream);

    // Read the content.
    response = reader.ReadToEnd();

    reader.Close();
    dataStream.Close();
    res.Close();
# ---------- end http_get ----------
http_get_2 = CSharpScript(url="http://localhost:8000/error", timeout=request_timeout_ms, send=bool)  # -> out, response; inputs url: String, timeout: Int32, send: Boolean; same code as http_get
http_get_3 = CSharpScript(url="http://localhost:8000/info", timeout=request_timeout_ms, send=bool)  # -> out, response; inputs url: String, timeout: Int32, send: Boolean; same code as http_get
last_response = Panel(http_get.response)
error_messages = Panel(http_get_2.response)
dejson = DeserializeJson(JSON=http_get_3.response, OutputsLocked=False)  # -> Inputs, Outputs
model_info_response_schema = Panel(dejson.Outputs)

# ---- group: Deserialize the response into the predicted text
dejsonkv = DeserializeKeysAndValues(JSON=http_post.response, Keys="generated_text")  # -> Key, Value
panel_4 = Panel(dejsonkv.Value)
